# Grasshopper definition 04_cull.gh (Grasshopper 1.0.7)

# ---- group: generate grid of points
rectangular = Rectangular(
    Plane=PlaneXY(0, 0, 0),
    SizeX=Slider(6, range=0..10),
    SizeY=Slider(20, range=0..30),
    ExtentX=Slider(27, range=0..30),
    ExtentY=Slider(10, range=0..30))  # -> Cells, Points

# ----
flip_matrix = FlipMatrix(Data=rectangular.Cells)

# ---- group: using pattern
panel = Panel("""1
0
1
1
0
1""")
geometry = Geometry(flatten(flip_matrix))
cull_pattern = CullPattern(List=rectangular.Cells, CullPattern=panel)

# ---- group: using nth
cull_nth = CullNth(List=geometry, CullFrequency=Slider(2, range=0..14))

# ----
boundary_surfaces = BoundarySurfaces(Edges=cull_nth)
custom_preview = CustomPreview(Geometry=boundary_surfaces, Material=ColourSwatch(SwatchColor=RGB(37, 168, 120)))
