# Grasshopper definition 06_moire pattern.gh (Grasshopper 1.0.7)

crv = Curve(reparameterize(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))

# ---- group: creating second curve
disc = Discontinuity(Curve=crv, Level=1)  # -> Points, Parameters
md_slider = MDSlider(
    SliderMode=0,
    slider_value=Point(0.9305086078, 0.1978115919, 0.5),
    x_domain=Domain(-15, 15),
    y_domain=Domain(-15, 15),
    z_domain=Domain(0, 1))
md_slider_2 = MDSlider(
    SliderMode=0,
    slider_value=Point(0.2080957586, 0.1297332019, 0.5),
    x_domain=Domain(-15, 15),
    y_domain=Domain(-15, 15),
    z_domain=Domain(0, 1))
md_slider_3 = MDSlider(
    SliderMode=0,
    slider_value=Point(0.6586864125, 0.5329115333, 0.5),
    x_domain=Domain(-15, 15),
    y_domain=Domain(-15, 15),
    z_domain=Domain(0, 1))
md_slider_4 = MDSlider(
    SliderMode=0,
    slider_value=Point(0.1651338519, 0.3348308656, 0.5),
    x_domain=Domain(-15, 15),
    y_domain=Domain(-15, 15),
    z_domain=Domain(0, 1))
item = ListItem(List=disc.Points, Index=0, Wrap=True)  # -> Item, Item1, Item2, Item3
addition = Addition(A=item.Item, B=md_slider)
addition_2 = Addition(A=item.Item1, B=md_slider_2)
addition_3 = Addition(A=item.Item3, B=md_slider_4)
addition_4 = Addition(A=item.Item2, B=md_slider_3)
pline = PolyLine(Vertices=[addition, addition_2, addition_4, addition_3], Closed="1")

# ----
pcen = PolygonCenter(Polyline=pline)  # -> CenterV, CenterE, CenterA
rotate = Rotate(Geometry=pline, Angle=degrees(Slider(18, range=0..100)), Plane=pcen.CenterV)  # -> Geometry, Transform
boundary = BoundarySurfaces(Edges=rotate.Geometry)
boundary_2 = BoundarySurfaces(Edges=crv)

# ---- group: get domain surface
number_slider = Slider(25, range=0..100)
number_slider_2 = Slider(15, range=0..100)

divide = DivideDomain²(Domain=boundary, UCount=number_slider, VCount=number_slider_2)
divide_2 = DivideDomain²(Domain=boundary_2, UCount=number_slider, VCount=number_slider_2)
subsrf = Isotrim(Surface=boundary, Domain=divide)
subsrf_2 = Isotrim(Surface=boundary_2, Domain=divide_2)

# ----
edges = BrepEdges(Brep=subsrf)  # -> Naked, Interior, NonManifold
edges_2 = BrepEdges(Brep=subsrf_2)  # -> Naked, Interior, NonManifold
join = JoinCurves(Curves=edges_2.Naked, Preserve=False)
join_2 = JoinCurves(Curves=edges.Naked, Preserve=False)
offset = OffsetCurve(Curve=join, Distance=1, Plane=PlaneXY(0, 0, 0), Corners=1)
offset_2 = OffsetCurve(Curve=join_2, Distance=1, Plane=PlaneXY(0, 0, 0), Corners=1)

# ---- group: matching data tree
trim = TrimTree(Tree=offset_2, Depth=Slider(1, range=0..10))
trim_2 = TrimTree(Tree=offset, Depth=Slider(1, range=0..10))

# ----
loft = Loft(Curves=[join_2, trim], Options={Adjust=False, Closed=False, LoftEnds=0, LoftSimp=0, LoftType=0, Rebuild=10, Refit=0.01})
loft_2 = Loft(Curves=[join, trim_2], Options={Adjust=False, Closed=False, LoftEnds=0, LoftSimp=0, LoftType=0, Rebuild=10, Refit=0.01})
preview = CustomPreview(Geometry=loft, Material=ColourSwatch(SwatchColor=RGB(184, 51, 255)))
preview_2 = CustomPreview(Geometry=loft_2, Material=ColourSwatch(SwatchColor=RGB(82, 119, 255)))
