# Grasshopper definition 01_rotate.gh (Grasshopper 1.0.7)

grid_size = Slider(4, range=0..10)

# ---- group: Create grid of cell and get center point of that cells
square = Square(Plane=PlaneXY(0, 0, 0), Size=grid_size, ExtentX=Slider(10, range=0..10), ExtentY=Slider(10, range=0..10))  # -> Cells, Points
area = Area(Geometry=square.Cells)  # -> Area, Centroid
point = Point(square.Points)
number_slider = Slider(1.8, range=0..2)
number_slider_2 = Slider(4, range=0..10)
number_slider_3 = Slider(0.177, range=0..1)
flip_matrix = FlipMatrix(Data=area.Centroid)
point_2 = Point(flip_matrix)

# ---- group: create a geometry base on grid of points
polygon = Polygon(Plane=area.Centroid, Radius=number_slider, Segments=number_slider_2, FilletRadius=number_slider_3)  # -> flatten(Polygon), Length

# ---- group: Rotate geometry by given input series
list_length = ListLength(List=polygon.Polygon)
series = Series(Start=0, Step=Slider(425, range=0..1000), Count=list_length)
area_2 = Area(Geometry=polygon.Polygon)  # -> Area, Centroid
radians = Radians(Degrees=series)
rotate = Rotate(Geometry=polygon.Polygon, Angle=radians, Plane=area_2.Centroid)  # -> Geometry, Transform

# ----
boundary = BoundarySurfaces(Edges=rotate.Geometry)
