# Grasshopper definition 02_random.gh (Grasshopper 1.0.7)

# ---- group: Create a base points
hexagonal = Hexagonal(Plane=PlaneXY(0, 0, 0), Size=1, ExtentX=Slider(9, range=0..10), ExtentY=Slider(10, range=0..10))  # -> Cells, Points
point = Point(hexagonal.Points)

# ---- group: generate random number
number_slider = Slider(0.282, range=0..1)
list_length = ListLength(List=point)
construct_domain = ConstructDomain(DomainStart=Slider(3.255, range=0..10), DomainEnd=number_slider)
random = Random(Range=construct_domain, Number=list_length, Seed=Slider(52, range=0..100))

# ----
flip_matrix = FlipMatrix(Data=point)

# ---- group: generate geometry
polygon = Polygon(Plane=point, Radius=number_slider, Segments=Slider(4, range=3..10), FilletRadius=Slider(0.038, range=0..1))  # -> Polygon, Length
circle = Circle(Plane=point, Radius=1)

# ----
panel = Panel(random)

# ---- group: Scale geometry base on random factor
scale = Scale(Geometry=polygon.Polygon, Center=point, Factor=random)  # -> Geometry, Transform

# ----
boundary = BoundarySurfaces(Edges=scale.Geometry)
preview = CustomPreview(Geometry=boundary, Material=ColourSwatch(SwatchColor=RGB(228, 199, 131)))
