# Grasshopper definition 03_move.gh (Grasshopper 1.0.7)

# ---- group: Create points grid
series = Series(Start=0, Step=Slider(7, range=0..10), Count=Slider(10, range=0..10))
series_2 = Series(Start=0, Step=Slider(2, range=0..10), Count=Slider(20, range=0..20))
construct_point = ConstructPoint(XCoordinate=series_2, YCoordinate=graft(series), ZCoordinate=0)

# ----
number_slider = Slider(5, range=0..10)
expression = Expression(x=number_slider, Expression="-x/2  ")
expression_2 = Expression(x=number_slider, Expression="x/2  ")
dom = ConstructDomain(DomainStart=expression_2, DomainEnd=expression)
panel = Panel(dom)

# ---- group: create a rectangle from points
division = Division(A=Slider(5.43, range=-0.001..7), B="2")
division_2 = Division(A=Slider(1.926, range=0..2), B="2")
construct_domain = ConstructDomain(DomainStart=division_2, DomainEnd=expr("-x", division_2))
construct_domain_2 = ConstructDomain(DomainStart=division, DomainEnd=expr("-x", division))
rectangle = Rectangle(Plane=construct_point, XSize=construct_domain, YSize=construct_domain_2, Radius=0)  # -> Rectangle, Length

# ----
geometry = Geometry(rectangle.Rectangle)

# ---- group: random value
number_slider_2 = Slider(8.47, range=0..10)
list_length = ListLength(List=geometry)
construct_domain_3 = ConstructDomain(DomainStart=number_slider_2, DomainEnd=expr("-x", number_slider_2))
random = Random(Range=construct_domain_3, Number=list_length, Seed=Slider(15, range=0..100))
unit_y = UnitY(Factor=random)

# ----
move = Move(Geometry=geometry, Motion=unit_y)  # -> Geometry, Transform
boundary_surfaces = BoundarySurfaces(Edges=move.Geometry)
preview = CustomPreview(Geometry=boundary_surfaces, Material=ColourSwatch(SwatchColor=RGB(214, 65, 255)))
