# Grasshopper definition 05_attractor.gh (Grasshopper 1.0.7)

# ---- group: Create a Rectangle Cell
# Attractor Curve (Wavy Surface)
size_of_the_grid = Slider(3, range=0..10)
extend = Slider(20, range=0..20)
# First of all We need to ceate the Grid Cell by Using "Rectangle Cell"
rectangular = Rectangular(Plane=PlaneXY(0, 0, 0), SizeX=size_of_the_grid, SizeY=size_of_the_grid, ExtentX=extend, ExtentY=extend)  # -> Cells, Points

# ---- group: Extract the point frome the Cell
# After Create the grid cell We need to extract the centroid point it by using "Area" Command
area = Area(Geometry=rectangular.Cells)  # -> Area, flatten(Centroid)

# ---- group: Object that going to be an attractor
curve = Curve(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)

# ---- group: Pull All the point to the closest Geometry
pull_point = PullPoint(Point=area.Centroid, Geometry=curve, ClosestOnly=True)  # -> ClosestPoint, Distance

# ---- group: Remap the value from the Closest Point
bounds = Bounds(Numbers=pull_point.Distance)
# What is Remap: Remap Function is just like Normalize. It take the input value and find a Min and Max of the Value covert it to the Target value that we need Like 0-1
remap_numbers = RemapNumbers(Value=pull_point.Distance, Source=bounds, Target=Domain(0, 1))  # -> Mapped, Clipped
construct_domain = ConstructDomain(DomainStart=Slider(0, range=0..100), DomainEnd=Slider(33, range=0..100))
graph_mapper = GraphMapper(
    remap_numbers.Mapped,
    x0=0,
    x1=1,
    y0=0,
    y1=1,
    container_name="Bezier",
    cpx=[0, 0.7544281483, 0.7190021276, 1],
    cpy=[0.1367697716, 0.06190448999, 0.9476191998, 0.6460318565])
remap_numbers_2 = RemapNumbers(Value=graph_mapper, Source=Domain(0, 1), Target=construct_domain)  # -> Mapped, Clipped

# ----
unit_z = UnitZ(Factor=remap_numbers_2.Mapped)

# ---- group: Move the Point in Z direction
move = Move(Geometry=area.Centroid, Motion=unit_z)  # -> flatten(Geometry), Transform

# ---- group: Divide the size of the list
# What Partition List do?: First of all Because of the input from the Move command is Flattern Mean that all the point is continuous so We need to separate the list by giving them a Size of the number that we want to divide.
partition_list = PartitionList(List=move.Geometry, Size=extend)

# ---- group: Connect the point
nurbs_curve = NurbsCurve(Vertices=partition_list, Degree=3, Periodic=False)  # -> flatten(Curve), Length, Domain

# ---- group: Create the surface
loft = Loft(
    Curves=nurbs_curve.Curve,
    Options={Adjust=False, Closed=False, LoftEnds=0, LoftSimp=0, LoftType=0, Rebuild=10, Refit=0.01})
surface_from_points = SurfaceFromPoints(Points=move.Geometry, UCount=extend, Interpolate=False)
