# Grasshopper definition 07_distance.gh (Grasshopper 1.0.7)

hexgrid = Hexagonal(Plane=PlaneXY(0, 0, 0), Size=1, ExtentX=Slider(20, range=0..100), ExtentY=Slider(30, range=0..100))  # -> Cells, flatten(Points)

# ---- group: get distance
pt = Point(Point(26.26281584, 24.1818152, 0))
dist = Distance(PointA=hexgrid.Points, PointB=pt)
division = Division(A=dist, B=Slider(40, range=0..100))

# ----
num = Number(flatten(division))
bnd = Bounds(Numbers=num)
dedomain = DeconstructDomain(Domain=bnd)  # -> Start, End
gradient = Gradient(
    LowerLimit=dedomain.Start,
    UpperLimit=dedomain.End,
    Parameter=num,
    stops=[0.159: RGB(0, 98, 0), 0.441: RGB(81, 175, 17), 1: RGB(221, 255, 53)])
cir = Circle(Plane=hexgrid.Points, Radius=division)
boundary = BoundarySurfaces(Edges=cir)
preview = CustomPreview(Geometry=boundary, Material=gradient)
