# Grasshopper definition VectorLength.gh (Grasshopper 1.0.7)

pt = ConstructPoint(XCoordinate=0, YCoordinate=0, ZCoordinate=0)
vec = VectorXYZ(XComponent=Slider(7.9, range=0..10), YComponent=Slider(1.8, range=0..10), ZComponent=Slider(8.7, range=0..10))  # -> Vector, Length
vectorlength = CSharpScript(V=vec.Vector)  # -> out, L; inputs V: Vector3d
# ---------- vectorlength: C# ----------
    /*
    // Get values
    double x = V.X;
    double y = V.Y;
    double z = V.Z;

    // Compute vector length
    double length = Math.Sqrt(x * x + y * y + z * z);
    */

    
    // Output
    //L = V.Length;
    L = VectorLength(V);
# ---------- vectorlength: C# additional code ----------
  // Calculate vector length
  double VectorLength(Vector3d V)
  {
    double length = Math.Sqrt(V.X * V.X + V.Y * V.Y + V.Z * V.Z);
    return length;
  }
# ---------- end vectorlength ----------
vectorlength_2 = GhPythonScript(V=vec.Vector)  # -> out, L; inputs V: Vector3d
# ---------- vectorlength_2: Python ----------
__author__ = "Administrator"
__version__ = "2021.08.17"

import rhinoscriptsyntax as rs
import math as m

###Get Vector length

#method1
#L = m.sqrt(V.X*V.X + V.Y*V.Y + V.Z*V.Z)

#method2 (using rhinoscriptsyntax)
#L = V.Length

#method3 (creating our own function
def VectorLength(V):
    return m.sqrt(V.X*V.X + V.Y*V.Y + V.Z*V.Z)

#output 
L = VectorLength(V)
# ---------- end vectorlength_2 ----------
vdis = VectorDisplay(Anchor=pt, Vector=vec.Vector)
panel = Panel(vec.Length)
panel_2 = Panel(vectorlength.L)
panel_3 = Panel(vectorlength_2.L)
