# Grasshopper definition Blocks.gh (Grasshopper 1.0.7)

# ---- group: input CURVE
# Site
# Create road network, pathway, site block using road segments and site boundary
site_boundary = Curve(<curve referenced from the Rhino model>)
road_segments = Curve([<curve referenced from the Rhino model> x8])

# ----
road_width = Slider(1.9, range=0..3)
road_corner_fillet = Slider(1.579, range=0..10)
pathway_width = Slider(2.3, range=0..10)
boundary_surfaces = BoundarySurfaces(Edges=site_boundary)
negative = Negative(Value=road_width)
negative_2 = Negative(Value=pathway_width)
surface_split = SurfaceSplit(Surface=boundary_surfaces, Curves=road_segments)
circle = Circle(Plane=PlaneXY(0, 0, 0), Radius=1)
flip_curve = FlipCurve(Curve=surface_split, Guide=circle)  # -> Curve, Flag
offset_curve = OffsetCurve(Curve=flip_curve.Curve, Distance=negative, Plane=PlaneXY(0, 0, 0), Corners=1)
offset_curve_2 = OffsetCurve(Curve=offset_curve, Distance=negative_2, Plane=PlaneXY(0, 0, 0), Corners=1)
fillet = Fillet(Curve=offset_curve, Radius=road_corner_fillet)
merge = Merge(Data1=fillet, Data2=offset_curve_2)
boundary_surfaces_2 = BoundarySurfaces(Edges=offset_curve)
boundary_surfaces_3 = BoundarySurfaces(Edges=merge)
area = Area(Geometry=boundary_surfaces_2)  # -> Area, Centroid
text_tag = TextTag(Location=area.Centroid, Text=area.Area)
