# Grasshopper definition 01.gh (Grasshopper 1.0.7)
# plug-ins: LunchBox, Kangaroo2 Components, NGon, Weaverbird

number_slider = Slider(68, range=0..100)
number_slider_2 = Slider(1000, range=0..1000)
sphere = Sphere(Base=PlaneXY(0, 0, 0), Radius=Slider(8213, range=0..10000))

rotate = Rotate(Geometry=sphere, Angle=degrees(Slider(148, range=20..180)), Plane=PlaneXY(0, 0, 0))  # -> Geometry, Transform
xz_plane = XZPlane(Origin=Point(0, 0, 0))
rotate_2 = Rotate(Geometry=rotate.Geometry, Angle=degrees(Slider(59, range=20..180)), Plane=xz_plane)  # -> Geometry, Transform
yz_plane = YZPlane(Origin=Point(0, 0, 0))
rotate_3 = Rotate(Geometry=rotate_2.Geometry, Angle=degrees(Slider(54, range=20..180)), Plane=yz_plane)  # -> Geometry, Transform

number_slider_3 = Slider(3, range=0..10)

number_slider_4 = Slider(8.59, range=0..10)
number_slider_5 = Slider(35, range=0..100)

space_truss_structure_2 = SpaceTrussStructure2(SurfaceA=sphere, SurfaceB=rotate_3.Geometry, UDivisions=number_slider_3, VDivisions=number_slider_3)  # -> PrimaryLines, PrimaryLines_2, WebLines, StructureNodes
multipipe = MultiPipe(
    Curves=[space_truss_structure_2.PrimaryLines_2, space_truss_structure_2.WebLines],
    NodeSize=Slider(283, range=0..1000),
    EndOffset=Slider(405, range=0..1000),
    StrutSize=1,
    Segment=0,
    KinkAngle=0.6,
    CubeFit=0)
Z = UnitZ(Factor=Slider(3317, range=0..10000))
move = Move(Geometry=multipipe, Motion=Z)  # -> Geometry, Transform
rotate_4 = Rotate(Geometry=move.Geometry, Angle=degrees(Slider(337, range=0..1000)), Plane=PlaneXY(0, 0, 0))  # -> Geometry, Transform
Z_2 = UnitZ(Factor=1)
data_dam = DataDam(DataDataA=rotate_4.Geometry, BufferDelay=10000000, BufferMode=0)
deconstruct_brep = DeconstructBrep(Brep=data_dam)  # -> Faces, Edges, Vertices

# ---- group: offset surface
area = Area(Geometry=deconstruct_brep.Faces)  # -> Area, Centroid
surface_closest_point = SurfaceClosestPoint(Point=area.Centroid, Surface=reparameterize(deconstruct_brep.Faces))  # -> Point, UVPoint, Distance
evaluate_surface = EvaluateSurface(Surface=reparameterize(deconstruct_brep.Faces), Point=surface_closest_point.UVPoint)  # -> Point, Normal, UDirection, VDirection, Frame
amplitude = Amplitude(Vector=evaluate_surface.Normal, Amplitude=Slider(1.2, range=1..2))
move_2 = Move(Geometry=deconstruct_brep.Faces, Motion=amplitude)  # -> Geometry, Transform

# ----
area_2 = Area(Geometry=move_2.Geometry)  # -> Area, Centroid
number_slider_6 = Slider(6, range=0..10)
scale = Scale(Geometry=move_2.Geometry, Center=area_2.Centroid, Factor=Slider(0.8, range=0..1))  # -> Geometry, Transform
space_truss_structure_2_2 = SpaceTrussStructure2(SurfaceA=deconstruct_brep.Faces, SurfaceB=scale.Geometry, UDivisions=number_slider_6, VDivisions=number_slider_6)  # -> PrimaryLines, PrimaryLines_2, WebLines, StructureNodes
mesh = MeshBrep(
    Brep=deconstruct_brep.Faces,
    Settings={GridMaxCount=0, GridMinCount=16, JaggedSeams=False, MaxEdgeLength=0, MinEdgeLength=0.0001, MinTolerance=0, Refine=True, RefineAngle=0, RelativeTolerance=0.65, SimplePlanes=True, Tolerance=0})
number_slider_7 = Slider(0.35, range=0..1)  # disabled
number_slider_8 = Slider(4, range=0..10)  # disabled
number_slider_9 = Slider(0, range=0..100)  # disabled
number_slider_10 = Slider(5, range=0..10)  # disabled
meshpipe = MeshPipe(
    Curve=[space_truss_structure_2_2.PrimaryLines, space_truss_structure_2_2.PrimaryLines_2, space_truss_structure_2_2.WebLines],
    Radius=number_slider_10,
    Sides=number_slider_8,
    Tolerance=10,
    Ending=number_slider_9)  # disabled
weaverbird_s_offset_mesh = WeaverbirdsOffsetMesh(MeshCurves=mesh, Distance=Slider(10, range=0..10), OffsetType=0)
mesh_join = MeshJoin(Meshes=meshpipe)
weaverbird_s_laplacian_smoothing = WeaverbirdsLaplacianSmoothing(MeshCurves=weaverbird_s_offset_mesh, Level=Slider(2, range=0..10), SmoothNakedEdges=1, Thin=1)
weaverbird_s_catmull_clark_subdivision = WeaverbirdsCatmullClarkSubdivision(MeshCurves=mesh_join, Level=1, SmoothNakedEdges=1)
number_slider_11 = Slider(3, range=0..10)
number_slider_12 = Slider(0.01, range=0..0.1)
weaverbird_s_mesh_window = WeaverbirdsMeshWindow(MeshPolylines=weaverbird_s_laplacian_smoothing, Distance=Slider(10, range=0..100), InsetType=0)
weaverbird_s_picture_frame = WeaverbirdsPictureFrame(MeshPolylines=weaverbird_s_mesh_window, Distance=5, InsetType=0)
number_slider_13 = Slider(0.02, range=0..0.1)
number_slider_14 = Slider(10, range=0..10)
negative = Negative(Value=number_slider_14)
weaverbird_s_mesh_thicken = WeaverbirdsMeshThicken(MeshCurves=weaverbird_s_picture_frame, Distance=number_slider_14, OffsetType=0)
weaverbird_s_mesh_thicken_2 = WeaverbirdsMeshThicken(MeshCurves=weaverbird_s_mesh_window, Distance=Slider(7, range=0..10), OffsetType=0)
