# Grasshopper definition 02.gh (Grasshopper 1.0.7)
# plug-ins: NGon

number_slider = Slider(20, range=0..100)  # disabled
number_slider_2 = Slider(30, range=0..100)  # disabled
number_slider_3 = Slider(60, range=0..100)  # disabled
number_slider_4 = Slider(9, range=0..10)  # disabled
number_slider_5 = Slider(1800, range=0..2000)  # disabled
number_slider_6 = Slider(12, range=0..100)  # disabled
box = CenterBox(Base=PlaneXY(0, 0, 0), X=number_slider, Y=number_slider_3, Z=number_slider_2)  # disabled
number_slider_7 = Slider(5736, range=0..10000)  # disabled
brep = Brep(<brep referenced from the Rhino model>)  # disabled
pop3d = Populate3D(Region=box, Count=number_slider_5, Seed=number_slider_7)  # disabled
pop3d_2 = Populate3D(Region=box, Count=number_slider_6, Seed=1)  # disabled
pop3d_3 = Populate3D(Region=brep, Count=number_slider_5, Seed=number_slider_7)  # disabled
number_slider_8 = Slider(5, range=0..10)  # disabled
number_slider_9 = Slider(122, range=20..180)  # disabled
number_slider_10 = Slider(7, range=0..10)  # disabled
number_slider_11 = Slider(6, range=0..10)  # disabled
pln = Plane(pop3d_2)  # disabled
deplane = DeconstructPlane(Plane=pln)  # -> Origin, XAxis, YAxis, ZAxis; disabled
lng = ListLength(List=pln)  # disabled
series = Series(Start=number_slider_8, Step=number_slider_9, Count=lng)  # disabled
rotate = Rotate(Geometry=pln, Angle=degrees(series), Plane=deplane.Origin)  # -> Geometry, Transform; disabled
deplane_2 = DeconstructPlane(Plane=rotate.Geometry)  # -> Origin, XAxis, YAxis, ZAxis; disabled
xz = XZPlane(Origin=deplane_2.Origin)  # disabled
rotate_2 = Rotate(Geometry=rotate.Geometry, Angle=degrees(series), Plane=xz)  # -> Geometry, Transform; disabled
deplane_3 = DeconstructPlane(Plane=rotate_2.Geometry)  # -> Origin, XAxis, YAxis, ZAxis; disabled
yz = YZPlane(Origin=deplane_3.Origin)  # disabled
number_slider_12 = Slider(5, range=0..10)  # disabled
number_slider_13 = Slider(30, range=0..100)  # disabled
rotate_3 = Rotate(Geometry=rotate_2.Geometry, Angle=degrees(series), Plane=yz)  # -> Geometry, Transform; disabled
number_slider_14 = Slider(30, range=0..1000)  # disabled
dom = ConstructDomain(DomainStart=number_slider_12, DomainEnd=number_slider_13)  # disabled
lng_2 = ListLength(List=rotate_3.Geometry)  # disabled
number_slider_15 = Slider(2, range=0..10)  # disabled
number_slider_16 = Slider(5, range=0..10)  # disabled
random = Random(Range=dom, Number=lng_2, Seed=number_slider_14)  # disabled
fspin = SpinForce(Plane=rotate_3.Geometry, Strength=number_slider_15, Radius=random, Decay=number_slider_16)  # disabled
mergef = MergeFields(Fields=fspin)  # disabled
fline = FieldLine(Field=mergef, Point=pop3d, Steps=1000, Accuracy=0.1, Method=3)  # disabled
number_slider_17 = Slider(0.4, range=0..1)  # disabled
number_slider_18 = Slider(0.5, range=0..1)  # disabled
number_slider_19 = Slider(3, range=0..10)  # disabled
number_slider_20 = Slider(4, range=0..10)  # disabled
meshpipe = MeshPipe(Curve=fline, Radius=number_slider_17, Sides=number_slider_19, Tolerance=10, Ending=0)  # disabled
meshpipe_2 = MeshPipe(Curve=fline, Radius=number_slider_18, Sides=number_slider_20, Tolerance=10, Ending=0)  # disabled
cull = CullPattern(List=meshpipe, CullPattern=[False, True])  # disabled
cull_2 = CullPattern(List=meshpipe, CullPattern=[True, False])  # disabled
mjoin = MeshJoin(Meshes=meshpipe_2)  # disabled
mjoin_2 = MeshJoin(Meshes=cull_2)  # disabled
mjoin_3 = MeshJoin(Meshes=cull)  # disabled
