# Grasshopper definition 04.gh (Grasshopper 1.0.7)
# plug-ins: Anemone

number_slider = Slider(10, range=0..10)
construct_domain = ConstructDomain(DomainStart=Slider(0, range=0..100), DomainEnd=Slider(208, range=0..1000))
range = Range(Domain=construct_domain, Steps=Slider(20, range=0..100))
construct_point = ConstructPoint(XCoordinate=Slider(0, range=0..100), YCoordinate=0, ZCoordinate=0)
unit_y = UnitY(Factor=range)
unit_x = UnitX(Factor=range)
unit_z = UnitZ(Factor=range)
move = Move(Geometry=construct_point, Motion=unit_y)  # -> Geometry, Transform
move_2 = Move(Geometry=move.Geometry, Motion=graft(unit_x))  # -> Geometry, Transform
move_3 = Move(Geometry=move_2.Geometry, Motion=graft(unit_z))  # -> Geometry, Transform
curve = Curve(<curve referenced from the Rhino model>)
curve_2 = Curve(<curve referenced from the Rhino model>)
curve_3 = Curve(<curve referenced from the Rhino model>)
curve_4 = Curve(<curve referenced from the Rhino model>)
point_on_curve = PointOnCurve(curve, parameter=0.752)
point_on_curve_2 = PointOnCurve(curve_2, parameter=0.774)
point_on_curve_3 = PointOnCurve(curve_3, parameter=0.115)
divide_curve = DivideCurve(Curve=curve_4, Count=Slider(2, range=0..10), Kinks=False)  # -> Points, Tangents, Parameters
point = Point(flatten(move_3.Geometry))
plane_normal = PlaneNormal(Origin=point_on_curve, ZAxis=curve)
plane_normal_2 = PlaneNormal(Origin=point_on_curve_2, ZAxis=curve_2)
plane_normal_3 = PlaneNormal(Origin=point_on_curve_3, ZAxis=curve_3)
plane_normal_4 = PlaneNormal(Origin=divide_curve.Points, ZAxis=divide_curve.Tangents)
spin_force = SpinForce(Plane=plane_normal_4, Strength=Slider(2, range=-10..10), Radius=Slider(30, range=0..100), Decay=Slider(5, range=0..100))
spin_force_2 = SpinForce(Plane=plane_normal, Strength=Slider(2, range=-10..10), Radius=Slider(10, range=0..100), Decay=Slider(5, range=0..100))
spin_force_3 = SpinForce(
    Plane=plane_normal_2,
    Strength=Slider(-9, range=-10..10),
    Radius=Slider(21, range=0..100),
    Decay=Slider(17, range=0..100))
spin_force_4 = SpinForce(Plane=plane_normal_3, Strength=Slider(5, range=-10..10), Radius=Slider(8, range=0..100), Decay=Slider(17, range=0..100))
merge_fields = MergeFields(Fields=flatten([spin_force, spin_force_2, spin_force_3, spin_force_4]))
field_line = FieldLine(Field=merge_fields, Point=point, Steps=Slider(5000, range=0..10000), Accuracy=0.1, Method=3)
number_slider_2 = Slider(50, range=0..100)
curve_5 = Curve(flatten(field_line))
data_dam = DataDam(DataA=curve_5, BufferDelay=10000000, BufferMode=0)
divide_curve_2 = DivideCurve(Curve=data_dam, Count=number_slider_2, Kinks=False)  # -> Points, Tangents, Parameters
loop_start = LoopStart(Repeat=number_slider_2, Data=data_dam)  # -> port, Counter, Data
split_list = SplitList(List=divide_curve_2.Points, Index=loop_start.Counter)  # -> ListA, ListB
interpolate = Interpolate(Vertices=split_list.ListA, Degree=3, Periodic=False, KnotStyle=1)  # -> Curve, Length, Domain
loop_end = LoopEnd(port=loop_start.port, Exit=False, Data=interpolate.Curve, TimeOutVal=0, pausedState=False, state="Constant output")
curve_6 = Curve(flatten(curve_5))
dispatch = Dispatch(List=curve_6, DispatchPattern=[True, False])  # -> ListA, ListB
curve_7 = Curve(dispatch.ListA)
curve_8 = Curve(dispatch.ListB)
pipe = Pipe(Curve=curve_8, Radius=Slider(0.5, range=0..1), Caps=0)
pipe_2 = Pipe(Curve=curve_7, Radius=Slider(0.8, range=0..1), Caps=0)
