# Grasshopper definition 06.gh (Grasshopper 1.0.7)
# plug-ins: Chromodoris, Weaverbird

number_slider = Slider(84, range=0..180)
quad_sphere = QuadSphere(Base=PlaneXY(0, 0, 0), Radius=Slider(2, range=0..10))
quad_sphere_2 = QuadSphere(Base=PlaneXY(0, 0, 0), Radius=Slider(4, range=0..10))
yz_plane = YZPlane(Origin=Point(0, 0, 0))
xz_plane = XZPlane(Origin=Point(0, 0, 0))
rotate = Rotate(Geometry=quad_sphere, Angle=degrees(Slider(26, range=0..180)), Plane=xz_plane)  # -> Geometry, Transform
rotate_2 = Rotate(Geometry=quad_sphere_2, Angle=degrees(number_slider), Plane=yz_plane)  # -> Geometry, Transform
xz_plane_2 = XZPlane(Origin=Point(0, 0, 0))
rotate_3 = Rotate(Geometry=rotate_2.Geometry, Angle=degrees(number_slider), Plane=xz_plane_2)  # -> Geometry, Transform
deconstruct_brep = DeconstructBrep(Brep=rotate_3.Geometry)  # -> Faces, Edges, Vertices
area = Area(Geometry=deconstruct_brep.Faces)  # -> Area, Centroid
deconstruct_brep_2 = DeconstructBrep(Brep=rotate.Geometry)  # -> Faces, Edges, Vertices
surface_closest_point = SurfaceClosestPoint(Point=area.Centroid, Surface=deconstruct_brep.Faces)  # -> Point, UVPoint, Distance
evaluate_surface = EvaluateSurface(Surface=deconstruct_brep.Faces, Point=surface_closest_point.Point)  # -> Point, Normal, UDirection, VDirection, Frame
construct_domain = ConstructDomain(DomainStart=Slider(4, range=0..100), DomainEnd=Slider(4, range=0..100))
list_length = ListLength(List=evaluate_surface.Point)
random = Random(Range=construct_domain, Number=list_length, Seed=Slider(20, range=0..100))
amplitude = Amplitude(Vector=evaluate_surface.Normal, Amplitude=random)
number_slider_2 = Slider(30, range=0..100)
move = Move(Geometry=deconstruct_brep.Faces, Motion=amplitude)  # -> Geometry, Transform
populate_geometry = PopulateGeometry(Geometry=move.Geometry, Count=number_slider_2, Seed=Slider(59, range=0..100))
populate_geometry_2 = PopulateGeometry(Geometry=deconstruct_brep_2.Faces, Count=number_slider_2, Seed=1)
line = Line(StartPoint=populate_geometry_2, EndPoint=populate_geometry)
divide_curve = DivideCurve(Curve=line, Count=10, Kinks=False)  # -> flatten(Points), Tangents, Parameters
sample_voxels = SampleVoxels(
    Points=divide_curve.Points,
    Charges=Slider(2.08, range=0..10),
    VoxelSize=Slider(0.3, range=0..10),
    EffectiveRange=Slider(0.33, range=0..10),
    DensitySampling=False,
    LinearSampling=True)  # -> Box, VoxelData
build_isosurface = BuildIsoSurface(Box=sample_voxels.Box, VoxelData=sample_voxels.VoxelData, SampleValue=Slider(6.74, range=0..10))
weaverbird_s_offset_mesh = WeaverbirdsOffsetMesh(MeshCurves=build_isosurface, Distance=Slider(0.095, range=0..0.1), OffsetType=0)
weaverbird_s_laplacian_smoothing = WeaverbirdsLaplacianSmoothing(MeshCurves=weaverbird_s_offset_mesh, Level=Slider(2, range=0..10), SmoothNakedEdges=1, Thin=1)
number_slider_3 = Slider(3, range=0..10)
weaverbird_s_mesh_window = WeaverbirdsMeshWindow(MeshPolylines=weaverbird_s_laplacian_smoothing, Distance=5, InsetType=0)
negative = Negative(Value=Slider(0.01, range=0..0.1))
weaverbird_s_picture_frame = WeaverbirdsPictureFrame(MeshPolylines=weaverbird_s_mesh_window, Distance=5, InsetType=0)
weaverbird_s_mesh_thicken = WeaverbirdsMeshThicken(MeshCurves=weaverbird_s_mesh_window, Distance=negative, OffsetType=0)
weaverbird_s_mesh_thicken_2 = WeaverbirdsMeshThicken(MeshCurves=weaverbird_s_picture_frame, Distance=Slider(0.02, range=0..0.1), OffsetType=0)
