# Grasshopper definition 07.little_island.gh (Grasshopper 1.0.7)
# plug-ins: Pufferfish

subd = SubD(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)
project = Project(Geometry=subd, Plane=PlaneXY(0, 0, 0))  # -> Geometry, Transform
bbox = BoundingBox(Content=project.Geometry, Plane=PlaneXY(0, 0, 0))  # -> Box, Box_2
item = ListItem(List=bbox.Box, Index=0, Wrap=True)
popgeo = PopulateGeometry(Geometry=item, Count=Slider(70, range=0..100), Seed=Slider(75, range=0..100))
voronoi = Voronoi(Points=popgeo, Boundary=item, BruteForceOverride=False)
brep = Brep(subd)
project_2 = Project(Curve=voronoi, Brep=brep, Direction=Vector(0, 0, 1))  # -> simplify(flatten(Curve))
disc = Discontinuity(Curve=project_2, Level=1)  # -> Points, Parameters
pline = PolyLine(Vertices=disc.Points, Closed=Toggle(True))
Z = UnitZ(Factor=Slider(1, range=0..10))
neg = Negative(Value=Z)
move = Move(Geometry=pline, Motion=neg)  # -> Geometry, Transform
pcen = PolygonCenter(Polyline=move.Geometry)  # -> CenterV, CenterE, CenterA
scale = Scale(Geometry=move.Geometry, Center=pcen.CenterV, Factor=Slider(0.79, range=0..1))  # -> Geometry, Transform
Z_2 = UnitZ(Factor=Slider(1, range=0..10))
neg_2 = Negative(Value=Z_2)
move_2 = Move(Geometry=scale.Geometry, Motion=neg_2)  # -> Geometry, Transform
pcen_2 = PolygonCenter(Polyline=move_2.Geometry)  # -> CenterV, CenterE, CenterA
cir = Circle(Plane=pcen_2.CenterV, Radius=Slider(0.5, range=0..1))
Z_3 = UnitZ(Factor=Slider(3, range=0..10))
neg_3 = Negative(Value=Z_3)
merge = Merge(Data1=pline, Data2=move.Geometry, Data3=move_2.Geometry)
Z_4 = UnitZ(Factor=Slider(1, range=0..10))
neg_4 = Negative(Value=Z_4)
move_3 = Move(Geometry=cir, Motion=neg_3)  # -> Geometry, Transform
fillet = Fillet(Curve=merge, Radius=Slider(0.2, range=0..1))
pt = ConstructPoint(XCoordinate=0, YCoordinate=0, ZCoordinate=0)
merge_2 = Merge(Data1=fillet, Data2=move_3.Geometry)
movetoplane = MoveToPlane(Geometry=move_3.Geometry, Plane=pt, Above=True, Below=True)  # -> Geometry, Transform
alicrvseams = AlignCurveSeams(Curves=merge_2, Snap=False, Iterative=True)  # -> Aligned, Points, R
merge_3 = Merge(Data1=move_3.Geometry, Data2=movetoplane.Geometry)
loft = Loft(
    Curves=alicrvseams.Aligned,
    Options={Adjust=False, Closed=False, LoftEnds=0, LoftSimp=0, LoftType=1, Rebuild=10, Refit=0.01})
loft_2 = Loft(Curves=merge_3, Options={Adjust=False, Closed=False, LoftEnds=0, LoftSimp=0, LoftType=0, Rebuild=10, Refit=0.01})
merge_4 = Merge(Data1=loft, Data2=loft_2)
