# Grasshopper definition 09.gh (Grasshopper 1.0.7)
# plug-ins: Weaverbird, LunchBox, ghgl

number_slider = Slider(6, range=0..10)
sph = Sphere(Base=PlaneXY(0, 0, 0), Radius=Slider(150, range=0..1000))
popgeo = PopulateGeometry(Geometry=sph, Count=number_slider, Seed=1)
dom = ConstructDomain(DomainStart=Slider(80, range=0..100), DomainEnd=Slider(100, range=0..300))
random = Random(Range=dom, Number=number_slider, Seed=Slider(30, range=0..100))
sph_2 = Sphere(Base=popgeo, Radius=random)
sunion = SolidUnion(Breps=sph_2)
number_slider_2 = Slider(20, range=0..100)
join = BrepJoin(Breps=sunion)  # -> Breps, Closed
popgeo_2 = PopulateGeometry(Geometry=join.Breps, Count=number_slider_2, Seed=1)
number_slider_3 = Slider(68, range=0..100)
dom_2 = ConstructDomain(DomainStart=Slider(60, range=0..100), DomainEnd=Slider(150, range=0..300))
dom_3 = ConstructDomain(DomainStart=Slider(25, range=0..100), DomainEnd=Slider(75, range=0..300))
random_2 = Random(Range=dom_3, Number=number_slider_2, Seed=number_slider_3)
random_3 = Random(Range=dom_2, Number=number_slider_2, Seed=number_slider_3)
box = CenterBox(Base=popgeo_2, X=random_2, Y=random_3, Z=random_2)
mesh = MeshBrep(
    Brep=box,
    Settings={GridMaxCount=0, GridMinCount=16, JaggedSeams=False, MaxEdgeLength=0, MinEdgeLength=0.0001, MinTolerance=0, Refine=True, RefineAngle=0, RelativeTolerance=0.65, SimplePlanes=True, Tolerance=0})
wbcatmullclark = WeaverbirdsCatmullClarkSubdivision(MeshCurves=mesh, Level=Slider(1, range=0..10), SmoothNakedEdges=1)
mjoin = MeshJoin(Meshes=flatten(wbcatmullclark))
number_slider_4 = Slider(10, range=0..100)
Z = UnitZ(Factor=1)
contour = Contour(Shape=mjoin, Point=Point(0, 0, 0), Direction=Z, Distance=number_slider_4)
explode = Explode(Curve=contour, Recursive=True)  # -> Segments, Vertices
Z_2 = UnitZ(Factor=number_slider_4)
extr = Extrude(Base=explode.Segments, Direction=Z_2)
area = Area(Geometry=extr)  # -> Area, Centroid
rotate = Rotate(Geometry=extr, Angle=degrees(Slider(70, range=0..100)), Plane=area.Centroid)  # -> Geometry, Transform
scale_nu = ScaleNU(Geometry=rotate.Geometry, Plane=area.Centroid, ScaleX=1, ScaleY=Slider(8, range=0..100), ScaleZ=Slider(0.9, range=0..1))  # -> Geometry, Transform
bbox = BoundingBox(Content=scale_nu.Geometry, Plane=PlaneXY(0, 0, 0))  # -> Box, Box_2
flatten = FlattenTree(Tree=bbox.Box, Path="{0}")
randomsplit = RandomSplitList(MasterList=flatten, Seed=2, Split=0.5)  # -> ListA, ListB
randomsplit_2 = RandomSplitList(MasterList=randomsplit.ListA, Seed=2, Split=0.5)  # -> ListA, ListB
mesh_2 = MeshBrep(
    Brep=randomsplit.ListB,
    Settings={GridMaxCount=0, GridMinCount=16, JaggedSeams=False, MaxEdgeLength=0, MinEdgeLength=0.0001, MinTolerance=0, Refine=True, RefineAngle=0, RelativeTolerance=0.65, SimplePlanes=True, Tolerance=0})
mesh_3 = MeshBrep(
    Brep=randomsplit_2.ListA,
    Settings={GridMaxCount=0, GridMinCount=16, JaggedSeams=False, MaxEdgeLength=0, MinEdgeLength=0.0001, MinTolerance=0, Refine=True, RefineAngle=0, RelativeTolerance=0.65, SimplePlanes=True, Tolerance=0})
mesh_4 = MeshBrep(
    Brep=randomsplit_2.ListB,
    Settings={GridMaxCount=0, GridMinCount=16, JaggedSeams=False, MaxEdgeLength=0, MinEdgeLength=0.0001, MinTolerance=0, Refine=True, RefineAngle=0, RelativeTolerance=0.65, SimplePlanes=True, Tolerance=0})
image_resource = ImageResource("https://raw.githubusercontent.com/nidorx/matcaps/master/1024/2D2D2F_C6C2C5_727176_94949B.png")
image_resource_2 = ImageResource("https://raw.githubusercontent.com/nidorx/matcaps/master/1024/2E763A_78A0B7_B3D1CF_14F209.png")
image_resource_3 = ImageResource("https://raw.githubusercontent.com/nidorx/matcaps/master/1024/323C4D_B79039_7C6A44_605C48.png")
matcap_texture = MatcapShader(
    M=mesh_3,
    U_texture=image_resource,
    DepthTestingEnabled=True,
    DepthWritingEnabled=True,
    DrawMode=4,
    FragmentShader="""#version 330

uniform vec3 _lightDirection[4];
uniform mat3 _worldToCameraNormal;
uniform sampler2D u_texture;

in  vec3 normal;
in vec2 texcoord;
in vec3 v_normal;
out vec4 fragment_color;

void main() {
  vec2 uv = v_normal.xy * 0.5 + 0.5;
  uv.y = 1.0 - uv.y;
    
  fragment_color = texture2D(u_texture,uv);
}""",
    GLShader=(0, 2, 0),
    PreviewSortOrder=5,
    VertexShader="""#version 330

layout(location = 0) in vec3 _meshVertex;
layout(location = 1) in vec3 _meshNormal;
layout(location = 2) in vec2 _meshTextureCoordinate;

uniform mat4 _worldToClip;
uniform mat3 _worldToCameraNormal;

out vec3 normal;
out vec3 v_normal;
out vec2 texcoord;

void main() {
  normal = _meshNormal;
  gl_Position = _worldToClip * vec4(_meshVertex , 1.0);
  v_normal = _worldToCameraNormal * normal;
  texcoord = _meshTextureCoordinate;
}""",
    glLineWidth=3,
    glPointSize=8)  # -> Color, Depth
matcap_texture_2 = MatcapShader(
    M=mesh_4,
    U_texture=image_resource_2,
    DepthTestingEnabled=True,
    DepthWritingEnabled=True,
    DrawMode=4,
    FragmentShader="""#version 330

uniform vec3 _lightDirection[4];
uniform mat3 _worldToCameraNormal;
uniform sampler2D u_texture;

in  vec3 normal;
in vec2 texcoord;
in vec3 v_normal;
out vec4 fragment_color;

void main() {
  vec2 uv = v_normal.xy * 0.5 + 0.5;
  uv.y = 1.0 - uv.y;
    
  fragment_color = texture2D(u_texture,uv);
}""",
    GLShader=(0, 2, 0),
    PreviewSortOrder=5,
    VertexShader="""#version 330

layout(location = 0) in vec3 _meshVertex;
layout(location = 1) in vec3 _meshNormal;
layout(location = 2) in vec2 _meshTextureCoordinate;

uniform mat4 _worldToClip;
uniform mat3 _worldToCameraNormal;

out vec3 normal;
out vec3 v_normal;
out vec2 texcoord;

void main() {
  normal = _meshNormal;
  gl_Position = _worldToClip * vec4(_meshVertex , 1.0);
  v_normal = _worldToCameraNormal * normal;
  texcoord = _meshTextureCoordinate;
}""",
    glLineWidth=3,
    glPointSize=8)  # -> Color, Depth
matcap_texture_3 = MatcapShader(
    M=mesh_2,
    U_texture=image_resource_3,
    DepthTestingEnabled=True,
    DepthWritingEnabled=True,
    DrawMode=4,
    FragmentShader="""#version 330

uniform vec3 _lightDirection[4];
uniform mat3 _worldToCameraNormal;
uniform sampler2D u_texture;

in  vec3 normal;
in vec2 texcoord;
in vec3 v_normal;
out vec4 fragment_color;

void main() {
  vec2 uv = v_normal.xy * 0.5 + 0.5;
  uv.y = 1.0 - uv.y;
    
  fragment_color = texture2D(u_texture,uv);
}""",
    GLShader=(0, 2, 0),
    PreviewSortOrder=5,
    VertexShader="""#version 330

layout(location = 0) in vec3 _meshVertex;
layout(location = 1) in vec3 _meshNormal;
layout(location = 2) in vec2 _meshTextureCoordinate;

uniform mat4 _worldToClip;
uniform mat3 _worldToCameraNormal;

out vec3 normal;
out vec3 v_normal;
out vec2 texcoord;

void main() {
  normal = _meshNormal;
  gl_Position = _worldToClip * vec4(_meshVertex , 1.0);
  v_normal = _worldToCameraNormal * normal;
  texcoord = _meshTextureCoordinate;
}""",
    glLineWidth=3,
    glPointSize=8)  # -> Color, Depth
