# Grasshopper definition 10 - Copy.gh (Grasshopper 1.0.7)
# plug-ins: Chromodoris, LunchBox, Weaverbird, ghgl

number_slider = Slider(22, range=0..100)
number_slider_2 = Slider(3000, range=0..10000)
sph = Sphere(Base=PlaneXY(0, 0, 0), Radius=Slider(117, range=0..1000))
sph_2 = Sphere(Base=PlaneXY(0, 0, 0), Radius=Slider(200, range=0..1000))
area = Area(Geometry=sph)  # -> Area, Centroid
rotate = Rotate(Geometry=sph, Angle=degrees(number_slider), Plane=area.Centroid)  # -> Geometry, Transform
area_2 = Area(Geometry=rotate.Geometry)  # -> Area, Centroid
rotate_2 = Rotate(Geometry=rotate.Geometry, Angle=degrees(number_slider), Plane=area_2.Centroid)  # -> Geometry, Transform
spacetruss_2 = SpaceTrussStructure2(SurfaceA=sph_2, SurfaceB=rotate_2.Geometry, UDivisions=10, VDivisions=10)  # -> LinesA, LinesB, Web, Nodes
popgeo = PopulateGeometry(Geometry=sph_2, Count=number_slider_2, Seed=1)
divide = DivideCurve(Curve=[spacetruss_2.LinesA, spacetruss_2.LinesB, spacetruss_2.Web], Count=10, Kinks=False)  # -> flatten(Points), Tangents, Parameters
pdecon = Deconstruct(Point=divide.Points)  # -> XComponent, YComponent, ZComponent
bnd = Bounds(Numbers=pdecon.ZComponent)
remap = RemapNumbers(Value=pdecon.ZComponent, Source=bnd, Target=Domain(0, 1))  # -> Mapped, Clipped
random = Random(Range=Domain(0, 1), Number=number_slider_2, Seed=Slider(67, range=0..100))
graph = GraphMapper(
    remap.Mapped,
    x0=0,
    x1=1,
    y0=0,
    y1=1,
    container_name="Bezier",
    cpx=[0, 0.3804312348, 0.7931553721, 1],
    cpy=[0, 0.7995451689, 0.4755635262, 1])
smaller = SmallerThan(FirstNumber=graph, SecondNumber=random)  # -> SmallerThan, OrEqualTo
cull = CullPattern(List=divide.Points, CullPattern=smaller.SmallerThan)
voxelsample = SampleVoxels(
    Points=cull,
    Charges=Slider(4.63, range=0..10),
    VoxelSize=Slider(7.03, range=0..10),
    EffectiveRange=Slider(16.47, range=0..100),
    DensitySampling=False,
    LinearSampling=True)  # -> Box, VoxelData
isosurface = BuildIsoSurface(Box=voxelsample.Box, VoxelData=voxelsample.VoxelData, SampleValue=Slider(0.68, range=0..10))
wboffset = WeaverbirdsOffsetMesh(MeshCurves=isosurface, Distance=Slider(1, range=0..1), OffsetType=0)
wbcatmullclark = WeaverbirdsCatmullClarkSubdivision(MeshCurves=isosurface, Level=1, SmoothNakedEdges=1)
wbframe = WeaverbirdsPictureFrame(MeshPolylines=wboffset, Distance=Slider(2, range=0..10), InsetType=0)
wbcatmullclark_2 = WeaverbirdsCatmullClarkSubdivision(MeshCurves=wbframe, Level=Slider(3, range=0..10), SmoothNakedEdges=1)
wbwindow = WeaverbirdsMeshWindow(MeshPolylines=wbcatmullclark, Distance=Slider(10, range=0..10), InsetType=0)
image_resource = ImageResource("https://raw.githubusercontent.com/nidorx/matcaps/master/1024/17395A_7EBCC7_4D8B9F_65A1B5.png")
image_resource_2 = ImageResource("https://raw.githubusercontent.com/nidorx/matcaps/master/1024/191514_6D5145_4E3324_3B564D.png")
matcap_texture = MatcapShader(
    M=wbcatmullclark_2,
    U_texture=image_resource,
    DepthTestingEnabled=True,
    DepthWritingEnabled=True,
    DrawMode=4,
    FragmentShader="""#version 330

uniform vec3 _lightDirection[4];
uniform mat3 _worldToCameraNormal;
uniform sampler2D u_texture;

in  vec3 normal;
in vec2 texcoord;
in vec3 v_normal;
out vec4 fragment_color;

void main() {
  vec2 uv = v_normal.xy * 0.5 + 0.5;
  uv.y = 1.0 - uv.y;
    
  fragment_color = texture2D(u_texture,uv);
}""",
    GLShader=(0, 2, 0),
    PreviewSortOrder=5,
    VertexShader="""#version 330

layout(location = 0) in vec3 _meshVertex;
layout(location = 1) in vec3 _meshNormal;
layout(location = 2) in vec2 _meshTextureCoordinate;

uniform mat4 _worldToClip;
uniform mat3 _worldToCameraNormal;

out vec3 normal;
out vec3 v_normal;
out vec2 texcoord;

void main() {
  normal = _meshNormal;
  gl_Position = _worldToClip * vec4(_meshVertex , 1.0);
  v_normal = _worldToCameraNormal * normal;
  texcoord = _meshTextureCoordinate;
}""",
    glLineWidth=3,
    glPointSize=8)  # -> Color, Depth
matcap_texture_2 = MatcapShader(
    M=wbwindow,
    U_texture=image_resource_2,
    DepthTestingEnabled=True,
    DepthWritingEnabled=True,
    DrawMode=4,
    FragmentShader="""#version 330

uniform vec3 _lightDirection[4];
uniform mat3 _worldToCameraNormal;
uniform sampler2D u_texture;

in  vec3 normal;
in vec2 texcoord;
in vec3 v_normal;
out vec4 fragment_color;

void main() {
  vec2 uv = v_normal.xy * 0.5 + 0.5;
  uv.y = 1.0 - uv.y;
    
  fragment_color = texture2D(u_texture,uv);
}""",
    GLShader=(0, 2, 0),
    PreviewSortOrder=5,
    VertexShader="""#version 330

layout(location = 0) in vec3 _meshVertex;
layout(location = 1) in vec3 _meshNormal;
layout(location = 2) in vec2 _meshTextureCoordinate;

uniform mat4 _worldToClip;
uniform mat3 _worldToCameraNormal;

out vec3 normal;
out vec3 v_normal;
out vec2 texcoord;

void main() {
  normal = _meshNormal;
  gl_Position = _worldToClip * vec4(_meshVertex , 1.0);
  v_normal = _worldToCameraNormal * normal;
  texcoord = _meshTextureCoordinate;
}""",
    glLineWidth=3,
    glPointSize=8)  # -> Color, Depth
