# Grasshopper definition 11.berlin_holocaust_memorial.gh (Grasshopper 1.0.7)

crv = Curve(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)
srf = Surface(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)
crv_2 = Curve([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])
number_slider = Slider(15, range=0..100)
loft = Loft(Curves=crv_2, Options={Adjust=False, Closed=False, LoftEnds=0, LoftSimp=0, LoftType=0, Rebuild=10, Refit=0.01})
srf_2 = Surface(loft)
colour = ColourPicker(PickedColour=RGB(41, 255, 255))
c_script = CSharpScript(
    boundaryCrv=crv,
    topSrf=srf,
    bottomSrf=srf_2,
    distanceX=Slider(10, range=0..100),
    distanceY=Slider(10, range=0..100),
    countX=Slider(20, range=0..100),
    countY=Slider(20, range=0..100),
    blockW=Slider(15, range=0..100),
    blockD=Slider(15, range=0..100),
    Seed=Slider(67, range=0..100),
    maxProbabillity=Slider(0.08, range=0..100),
    maxTilt=Slider(10, range=0..100))  # -> out, Points, BasePlane, B; inputs boundaryCrv: Curve, topSrf: Brep, bottomSrf: Brep, distanceX: Double, distanceY: Double, countX: Int32, countY: Int32, blockW: Double, blockD: Double, Seed: Int32, maxProbabillity: Double, maxTilt: Double
# ---------- c_script: C# ----------
    Print("Hello World");

    // Generate base point
    List<Point3d> basePoint = new List<Point3d>();

    for(int i = 0; i < countX; i++)
    {
      for(int j = 0; j < countY; j++)
      {
        double x = distanceX * i;
        double y = distanceY * j;
        Point3d pt = new Point3d(x, y, 0);

        // add point to the list
        basePoint.Add(pt);

      }
    }

    // Check the boundary Curve isPlanar
    if (!boundaryCrv.IsPlanar())
    {
      Component.AddRuntimeMessage(GH_RuntimeMessageLevel.Error, "Curve is not Planar");
      return;
    }

    // Extract plane from curve
    Plane curvePlane = new Plane();
    boundaryCrv.TryGetPlane(out curvePlane);

    // Cull point outside the curve
    var culledPts = new List<Point3d>();
    foreach(Point3d p in basePoint)
    {
      PointContainment pc = boundaryCrv.Contains(p, curvePlane, 0.01);
      if (pc == PointContainment.Inside)
      {
        culledPts.Add(p);
      }
    }

    // Cull closest point to the curve
    Random rnd = new Random(Seed);

    var randomCullPts = new List<Point3d>();
    foreach(Point3d p in culledPts)
    {
      double t = 0;
      boundaryCrv.ClosestPoint(p, out t);
      Point3d ptc = boundaryCrv.PointAt(t);

      //get the distance from p to ptc
      double dist = p.DistanceTo(ptc);
      double invD = 1 / dist;

      double r = maxProbabillity * rnd.NextDouble();
      Print(invD.ToString() + " " + r.ToString() + " " + rnd.NextDouble());
      // Calculate random number
      if(invD < r)
      {
        randomCullPts.Add(p);
      }

      // Project point to Breps
      // Project point to bottom surface
      Point3d[] ptsBottom = Rhino.Geometry.Intersect.Intersection.ProjectPointsToBreps(new List<Brep> { bottomSrf },
        randomCullPts,
        -Vector3d.ZAxis,
        0.001);
      // Project point to top surface
      Point3d[] ptsTop = Rhino.Geometry.Intersect.Intersection.ProjectPointsToBreps(new List<Brep> { topSrf },
        randomCullPts,
        Vector3d.ZAxis,
        0.001);

      // Plane one the bottom surface
      double TAU = 2 * Math.PI;
      double ToDegree = TAU / 360.0;


      Plane[] bottomPlane = new Plane[ptsBottom.Length];
      for(int i = 0; i < bottomPlane.Length; i++)
      {
        Plane pl = Plane.WorldXY;
        pl.Origin = ptsBottom[i];

        Vector3d vx = pl.XAxis;
        double rndAngle = TAU * rnd.NextDouble();
        vx.Rotate(rndAngle, Vector3d.ZAxis);

        double rndTiltAngle = maxTilt * ToDegree * rnd.NextDouble();
        pl.Rotate(rndTiltAngle, vx, pl.Origin);


        bottomPlane[i] = pl;
      }
      
      // Generate a Boxes from planes
      Box[] boxes = new Box[bottomPlane.Length];
      for(int i = 0; i < boxes.Length; i++)
      {
        //Calculate a dist from bottom to top surface
        double distance = ptsBottom[i].DistanceTo(ptsTop[i]);
        
        Box b = new Box(
          bottomPlane[i],
          new Interval  (-0.5 / 2 * blockW, 0.5 / 2 * blockW),
          new Interval  (-0.5 / 2 * blockD, 0.5 / 2 * blockD),
          new Interval  (0, distance));
        
        boxes[i] = b;
      }

      Points = ptsBottom;
      BasePlane = bottomPlane;
      B = boxes;


    }





    // Output
# ---------- end c_script ----------
hsl = ColourHSL(Alpha=1, Hue=colour, Saturation=Slider(0.321, range=0.1..1), Luminance=0.5)
preview = CustomPreview(Geometry=c_script.B, Material=hsl)
