# Grasshopper definition 13.gh (Grasshopper 1.0.7)

number_slider = Slider(29, range=0..100)
center_box = CenterBox(Base=PlaneXY(0, 0, 0), X=number_slider, Y=number_slider, Z=Slider(20, range=0..100))
number_slider_2 = Slider(57, range=0..180)
panel = Panel("""0
1
2
3
4
6""")
yz_plane = YZPlane(Origin=Point(0, 0, 0))
fillet_edge = FilletEdge(Shape=center_box, Blend=0, Metric=0, Edges=panel, Radii=Slider(5, range=0..10))
populate_geometry = PopulateGeometry(Geometry=fillet_edge, Count=Slider(46, range=0..100), Seed=Slider(42, range=0..100))
volume = Volume(Geometry=fillet_edge)  # -> Volume, Centroid
vector_2pt = Vector2Pt(PointA=populate_geometry, PointB=volume.Centroid, Unitize=False)  # -> Vector, Length
rotate = Rotate(Geometry=fillet_edge, Angle=degrees(number_slider_2), Plane=yz_plane)  # -> Geometry, Transform
xy_plane = XYPlane(Origin=Point(0, 0, 0))
amplitude = Amplitude(Vector=vector_2pt.Vector, Amplitude=Slider(40, range=0..100))
rotate_2 = Rotate(Geometry=rotate.Geometry, Angle=degrees(number_slider_2), Plane=xy_plane)  # -> Geometry, Transform
maelstrom = Maelstrom(
    Geometry=rotate_2.Geometry,
    Plane=PlaneXY(0, 0, 0),
    First=Slider(18, range=0..100),
    Second=Slider(26, range=0..100),
    Angle=degrees(Slider(50, range=0..180)),
    Rigid=False)
mesh_brep = MeshBrep(
    Brep=maelstrom,
    Settings={GridMaxCount=0, GridMinCount=16, JaggedSeams=False, MaxEdgeLength=0, MinEdgeLength=0.0001, MinTolerance=0, Refine=True, RefineAngle=0, RelativeTolerance=0.65, SimplePlanes=True, Tolerance=0})
spatial_deform = SpatialDeform(Geometry=mesh_brep, Syntax=populate_geometry, Forces=amplitude)
custom_preview = CustomPreview(
    Geometry=spatial_deform,
    Material={diffuse=RGB(221, 160, 221), emission=RGB(66, 48, 66), shine=0.5, specular=RGB(255, 255, 255), transparency=0})
